# Dynamo graph FindIt.dyn (Dynamo 2.16.2.5624)

file_path = Filename("..\..\AEC Tech Hackathon\Site_Sample_Image.png")
file_from_path = FileObject(path=file_path)
readFromFile = Image.ReadFromFile(file=file_from_path)
watch_image = WatchImageCore(image=readFromFile)
code_block = CodeBlock { "http://127.0.0.1:5000/api/upload"; }
boolean = BoolSelector(true)
code_block_2 = CodeBlock { null; }
if_ = RefactoredIf(test=boolean, true=file_path, false=code_block_2)
getTrees = FindIt.FindIt.GetTrees(url=code_block, image_path=if_)
transpose = List.Transpose(lists=getTrees)
code_block_3 = CodeBlock(x=transpose) { x[0]; x[1]; }
byCoordinates = Point.ByCoordinates(x=code_block_3.out0, y=code_block_3.out1)
code_block_4 = CodeBlock { 60; }
byCenterPointRadius = Sphere.ByCenterPointRadius(centerPoint=byCoordinates, radius=code_block_4)
