# Grasshopper definition findit-script.gh (Grasshopper 1.0.7)
# plug-ins: Weaverbird

# ----
# Tree Model Secection
tree_model_you_can_replace_that_with_you = Brep(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)  # "Tree Model - You can replace that with your own tree model"
pine_short_stump_tree = Brep(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)
pine_long_stump_tree = Brep(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)
thick_short_tree = Brep(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)
pine_cone_tree = Brep(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)
short_stump = Brep(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)
jungle_tree = Brep(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)
red_oak = Brep(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)

# ----
# Input (Drawing and Sample)
site_sketch = FilePath("C:\Users\Pawel\Documents\Code\AEC Hackathon 2023 NY\HackNY2023\handsketch.jpg")
tree_sample = FilePath("C:\Users\Pawel\Documents\Code\AEC Hackathon 2023 NY\HackNY2023\sketch_sample3.jpg")

# ---- group: Import remote python modules
# Turn me on!   -->
python = PythonScript()  # -> rhino_doc_dir
# ---------- python: Python ----------
import scriptcontext as sc
from os import path

rhino_doc_dir = path.abspath(path.dirname(sc.doc.Path))
# ---------- end python ----------
panel = Panel(python)
panel_2 = Panel("""numpy
cv2""")
list = ValueList({"CRITICAL", "ERROR", "WARNING", "INFO", "DEBUG", "NOTSET"}, selected="DEBUG")
ghpythonremote = GHPythonRemote(location="conda://rhinoremote", run=Toggle(True), modules=panel_2, log_level=list, working_dir=panel)  # -> out, linked_modules, rpy; inputs run: Boolean, modules: list
# ---------- ghpythonremote: Python ----------
import inspect
import logging
from os import path
import sys
from time import sleep

import scriptcontext

import ghpythonremote
from ghpythonremote.connectors import GrasshopperToPythonRemote
from Grasshopper.Kernel.GH_RuntimeMessageLevel import Error, Warning

local_log_level = getattr(logging, log_level, logging.WARNING)
logger = logging.getLogger("ghpythonremote")
logger.setLevel(local_log_level)
ch = logging.StreamHandler()
ch.setLevel(local_log_level)
formatter = logging.Formatter("%(levelname)s: %(name)s:\n%(message)s")
ch.setFormatter(formatter)
logger.handlers = []
logger.addHandler(ch)
logger = logging.getLogger("ghpythonremote.GH_to_python")

ROOT = path.abspath(path.dirname(inspect.getfile(ghpythonremote)))
rpyc_server_py = path.join(ROOT, "pythonservice.py")

cluster_comp = ghenv.Component.OnPingDocument().Owner

# Set connection to CLOSED if this is the first run
# and initialize set of linked modules
try:
    remote_python_status
except NameError:
    remote_python_status = "CLOSED"
    lkd_modules = set()

# Wait for connection to connect or terminate
timer = 0
while remote_python_status == "CONNECTING" or remote_python_status == "CLOSING":
    sleep(1)
    timer += 1
    if timer == 10:
        try:
            gh2py_manager.__exit__(*sys.exc_info())
        except Exception:
            pass
        remote_python_status = "CLOSED"
        lkd_modules = set()
        message = (
            "Connection left in an inconsistent state and not returning. Reset "
            "everything."
        )
        if cluster_comp is not None:
            cluster_comp.AddRuntimeMessage(Warning, message)
        raise RuntimeError(message)

if run:
    if not remote_python_status == "OPEN":
        remote_python_status = "CONNECTING"
        gh2py_manager = GrasshopperToPythonRemote(
            rpyc_server_py,
            location=location,
            timeout=10,
            port=None,
            log_level=log_level,
            working_dir=working_dir,
        )
        gh2py = gh2py_manager.__enter__()
        remote_python_status = "OPEN"

    # Stuff that we can reach
    rpymod = gh2py.py_remote_modules  # A getter function for a named python module
    rpy = gh2py.connection  # Represents the remote instance root object
    scriptcontext.sticky["rpy"] = rpy
    # Add modules
    for mod in modules:
        try:
            scriptcontext.sticky[mod] = rpymod(mod)
            lkd_modules.add(mod)
        except ImportError:
            gh2py_manager.__exit__(*sys.exc_info())
            if cluster_comp is not None:
                cluster_comp.AddRuntimeMessage(
                    Error,
                    'Could not import module "{}" in remote Python.'.format(mod)
                )
            raise
        except EOFError:
            if cluster_comp is not None:
                cluster_comp.AddRuntimeMessage(
                    Error,
                    'Remote Python has been closed unexpectedly'
                )
            raise

elif not remote_python_status == "CLOSED":
    remote_python_status = "CLOSING"
    # Remove linked modules
    for mod in lkd_modules:
        del scriptcontext.sticky[mod]
    del scriptcontext.sticky["rpy"]
    gh2py_manager.__exit__(*sys.exc_info())
    lkd_modules = set()
    remote_python_status = "CLOSED"

# Change variable name because ghpython resets outputs to None before each run
linked_modules = lkd_modules

logger.info("GH to python connection is {}".format(remote_python_status))
# ---------- end ghpythonremote ----------
panel_3 = Panel(ghpythonremote.out)
python_2 = PythonScript(module_names=ghpythonremote.linked_modules)  # -> import_statements; inputs module_names: list
# ---------- python_2: Python ----------
import_statements = ["import scriptcontext as sc"]
for module_name in module_names:
    import_statements.append("{0} = sc.sticky['{0}']".format(module_name))

if len(module_names) == 0:
    import_statements = []
# ---------- end python_2 ----------
panel_4 = Panel(python_2)

# ----
# Variation Factor of Trees' Height
diameter_to_height_proportion = Slider(2.1, range=0..3)
variation_factor = Slider(5, range=0..10)

# ----
# ML  Processing
python_3 = PythonScript(image_path=site_sketch, sample_path=tree_sample)  # -> out, csv_list
# ---------- python_3: Python ----------
import scriptcontext
import ghpythonremote
np = scriptcontext.sticky['numpy']
cv = scriptcontext.sticky['cv2']
#rpy = scriptcontext.sticky['rpy']
#px = scriptcontext.sticky['plotly.express']
## Do some numpy stuff
#a = np.arange(15).reshape(3, 5)
#print(a)
#print(np.linalg.eig(np.arange(9).reshape(3, 3)))
#
## Fast way of sending data for numpy array creation
#remote_range = ghpythonremote.deliver(rpy, range(1000))
#array = np.array(remote_range)
## This is much slower
##b = np.array(range(1000))
#
## Get the array back as a local IronPython list
#list = ghpythonremote.obtain(array.tolist())
#
## Get an error
##np.arange(9).reshape(4,3)

input_image_path = image_path
template_image_path = sample_path
img_rgb = cv.imread(input_image_path)
assert img_rgb is not None, "file could not be read, check with os.path.exists()"
img_gray = cv.cvtColor(img_rgb, cv.COLOR_BGR2GRAY)
template = cv.imread(template_image_path, cv.IMREAD_GRAYSCALE)
assert template is not None, "file could not be read, check with os.path.exists()"
algorithm =cv.TM_CCOEFF_NORMED
# algorithm =cv.TM_SQDIFF
threshold_list = [0.2, 0.3, 0.4, 0.45, 0.5, 0.9]
selected_t= 0.4
csv_list=[]
#for r in threshold_list:
#    filename =f"{str(algorithm)}_{str(r)}_res.png"
w, h = template.shape[::-1]
res = cv.matchTemplate(img_gray,template,algorithm )
loc = np.where( res >= selected_t)
count = 0
new_img = img_rgb.copy()
for pt in zip(*loc[::-1]):
    pp = (int(pt[0] + w/2), int(pt[1] + h/2))
    cv.circle(new_img, pp,radius=2,  color=(0, 0, 255), thickness=-1)
    count += 1
#    if (r==selected_t):
    csv_list.append(pp)
#    print(f"threshold: {r}, count: {count}")
#    cv.imwrite(filename,new_img)
#csv_file = open("result.csv", "w")
#for c in csv_list:
#    csv_file.write(f"{c[0]},{c[1]}\n")
# ---------- end python_3 ----------
panel_5 = Panel(python_3.out)  # disabled
panel_6 = Panel(site_sketch)

# ----
# Text Output to Integers
panel_7 = Panel(python_3.csv_list)
text_split = TextSplit(Text=panel_7, Separators=",")
list_item = ListItem(List=text_split, Index=0, Wrap=True)  # -> Item, Item1
text_split_2 = TextSplit(Text=list_item.Item1, Separators=")")  # -> flatten(Result)
text_split_3 = TextSplit(Text=list_item.Item, Separators="(")  # -> flatten(Result)
cull_pattern = CullPattern(List=text_split_2, CullPattern=text_split_2)
cull_pattern_2 = CullPattern(List=text_split_3, CullPattern=text_split_3)
construct_point = ConstructPoint(XCoordinate=cull_pattern_2, YCoordinate=cull_pattern, ZCoordinate=0)

# ----
# Sample Image Preview and Size Extraction
sketch_image = ImportImage(File=tree_sample)
wbnaked = WeaverbirdsNakedBoundary(MeshClosedPolylines=sketch_image)
explode = Explode(Curve=wbnaked, Recursive=True)  # -> Segments, Vertices
pdecon = Deconstruct(Point=explode.Vertices)  # -> XComponent, YComponent, ZComponent
sort = SortList(Keys=pdecon.XComponent)  # -> Keys, ValuesA
sort_2 = SortList(Keys=pdecon.YComponent)  # -> Keys, ValuesA
item = ListItem(List=sort.Keys, Index=0, Wrap=True)  # -> Item1, Item
item_2 = ListItem(List=sort_2.Keys, Index=0, Wrap=True)  # -> Item1, Item
multiplication = Multiplication(A=item_2.Item1, B=Slider(2, range=0..10))
neg = Negative(Value=multiplication)
X = UnitX(Factor=neg)
sample_preview = Move(Geometry=sketch_image, Motion=X)  # -> Geometry, Transform

# ----
# Image Site Drawing Preview
img = ImportImage(File=site_sketch)
wbnaked_2 = WeaverbirdsNakedBoundary(MeshClosedPolylines=img)
explode_2 = Explode(Curve=wbnaked_2, Recursive=True)  # -> Segments, Vertices
pdecon_2 = Deconstruct(Point=explode_2.Vertices)  # -> XComponent, YComponent, ZComponent
sort_3 = SortList(Keys=pdecon_2.YComponent)  # -> Keys, ValuesA
sort_4 = SortList(Keys=pdecon_2.XComponent)  # -> Keys, ValuesA
item_3 = ListItem(List=sort_3.Keys, Index=0, Wrap=True)  # -> Item1, Item
item_4 = ListItem(List=sort_4.Keys, Index=0, Wrap=True)  # -> Item1, Item
number_slider = Slider(0, range=0..100)
division = Division(A=item_3.Item1, B=Slider(2, range=0..10))
division_2 = Division(A=item_4.Item1, B=Slider(2, range=0..10))
pt = ConstructPoint(XCoordinate=item_4.Item1, YCoordinate=division, ZCoordinate=number_slider)
pt_2 = ConstructPoint(XCoordinate=Slider(0, range=0..100), YCoordinate=division, ZCoordinate=number_slider)
pline = PolyLine(Vertices=[pt, pt_2], Closed=False)

# ----
# Data to Bounding Box Conversion
panel_8 = Panel("2")
mirror = MirrorCurve(Geometry=construct_point, Curve=pline, Tangent=True)
number_slider_2 = Slider(4, range=0..10)
division_3 = Division(A=item.Item1, B="2")
division_4 = Division(A=item_2.Item1, B=panel_8)
pt_3 = Point(Point(0, 0, 0))
pt_4 = ConstructPoint(XCoordinate=division_3, YCoordinate=division_4, ZCoordinate="0")
cullpt = CullDuplicates(Points=mirror, Tolerance=Slider(20, range=0..100), CullMode=3)  # -> Points, Indices, Valence
vec2pt = Vector2Pt(PointA=pt_3, PointB=pt_4, Unitize=False)  # -> Vector, Length
neg_2 = Negative(Value=vec2pt.Vector)
division_5 = Division(A=item_2.Item1, B="2")
move = Move(Geometry=cullpt.Points, Motion=neg_2)  # -> Geometry, Transform
_2d_trees = Circle(Plane=cullpt.Points, Radius=division_5)
multiplication_2 = Multiplication(A=diameter_to_height_proportion, B=item_2.Item1)
rectangle = Rectangle(Plane=move.Geometry, XSize=item.Item1, YSize=item_2.Item1, Radius=0)  # -> Rectangle, Length
Z = UnitZ(Factor=multiplication_2)
extr = Extrude(Base=rectangle.Rectangle, Direction=flatten(Z))
bbox = BoundingBox(Content=extr, Plane=PlaneXY(0, 0, 0))  # -> Box, Box_2
volume = Volume(Geometry=bbox.Box)  # -> Volume, Centroid
debox = DeconstructBox(Box=bbox.Box)  # -> Plane, X, Y, Z
dedomain = DeconstructDomain(Domain=debox.Z)  # -> Start, End
dedomain_2 = DeconstructDomain(Domain=debox.X)  # -> Start, End
subtraction = Subtraction(A=dedomain.End, B=dedomain.Start)
subtraction_2 = Subtraction(A=dedomain_2.End, B=dedomain_2.Start)

# ----
# Filter Trees That Are Too Small (Optional)
this_number_ft = Slider(12, range=0..100)
larger = LargerThan(FirstNumber=subtraction, SecondNumber=this_number_ft)  # -> LargerThan, OrEqualTo
dispatch = Dispatch(List=subtraction, DispatchPattern=larger.LargerThan)  # -> ListA, ListB
dispatch_2 = Dispatch(List=volume.Centroid, DispatchPattern=larger.LargerThan)  # -> ListA, ListB
dispatch_3 = Dispatch(List=subtraction_2, DispatchPattern=larger.LargerThan)  # -> ListA, ListB

# ----
# Bounding Box to 3D Tree Model
bbox_2 = BoundingBox(Content=red_oak, Plane=PlaneXY(0, 0, 0))  # -> Box, Box_2
bbox_3 = BoundingBox(Content=red_oak, Plane=PlaneXY(0, 0, 0))  # -> Box, Box_2
debox_2 = DeconstructBox(Box=bbox_2.Box)  # -> Plane, X, Y, Z
volume_2 = Volume(Geometry=bbox_3.Box)  # -> Volume, Centroid
vec2pt_2 = Vector2Pt(PointA=volume_2.Centroid, PointB=dispatch_2.ListA, Unitize=False)  # -> Vector, Length
dedomain_3 = DeconstructDomain(Domain=debox_2.Z)  # -> Start, End
dedomain_4 = DeconstructDomain(Domain=debox_2.X)  # -> Start, End
subtraction_3 = Subtraction(A=dedomain_4.End, B=dedomain_4.Start)
subtraction_4 = Subtraction(A=dedomain_3.End, B=dedomain_3.Start)
move_2 = Move(Geometry=red_oak, Motion=vec2pt_2.Vector)  # -> Geometry, Transform
division_6 = Division(A=dispatch_3.ListA, B=subtraction_3)
division_7 = Division(A=dispatch.ListA, B=subtraction_4)

# ----
# Final Processing 3D Model (Variation in Location, Scale)
scale_nu = ScaleNU(Geometry=move_2.Geometry, Plane=dispatch_2.ListA, ScaleX=division_6, ScaleY=division_6, ScaleZ=division_7)  # -> Geometry, Transform
bbox_4 = BoundingBox(Content=scale_nu.Geometry, Plane=PlaneXY(0, 0, 0))  # -> Box, Box_2
debox_3 = DeconstructBox(Box=bbox_4.Box)  # -> Plane, X, Y, Z
division_8 = Division(A=item_2.Item1, B=variation_factor)
dedomain_5 = DeconstructDomain(Domain=debox_3.Y)  # -> graft(Start), graft(End)
dedomain_6 = DeconstructDomain(Domain=debox_3.X)  # -> graft(Start), graft(End)
dedomain_7 = DeconstructDomain(Domain=debox_3.Z)  # -> Start, End
lng = ListLength(List=debox_3.Z)
dom = ConstructDomain(DomainStart=Slider(0, range=0..100), DomainEnd=division_8)
avr = Average(Input=[dedomain_6.Start, dedomain_6.End])
avr_2 = Average(Input=[dedomain_5.Start, dedomain_5.End])
subtraction_5 = Subtraction(A=dedomain_7.End, B=dedomain_7.Start)
random = Random(Range=dom, Number=lng, Seed=2)
pt_5 = ConstructPoint(XCoordinate=flatten(avr), YCoordinate=flatten(avr_2), ZCoordinate=dedomain_7.Start)
addition = Addition(A=subtraction_5, B=random)
division_9 = Division(A=addition, B=subtraction_5)
scale_nu_2 = ScaleNU(Geometry=scale_nu.Geometry, Plane=pt_5, ScaleX=1, ScaleY=1, ScaleZ=division_9)  # -> Geometry, Transform
volume_3 = Volume(Geometry=bbox_4.Box)  # -> Volume, Centroid
lng_2 = ListLength(List=volume_3.Centroid)
random_2 = Random(Range="0 to 360", Number=lng_2, Seed=2)
rotate = Rotate(Geometry=scale_nu_2.Geometry, Angle=degrees(random_2), Plane=volume_3.Centroid)  # -> Geometry, Transform

# ----
# 3D Representation of Trees (BAKE ME!)
brep_trees = Brep(rotate.Geometry)
